# Grasshopper definition speckle_test.gh (Grasshopper 1.0.7)
# plug-ins: Speckle 2

list = Accounts(
    {"No account selected": , "Account (shervinazadi93@gmail.com | https://speckle.xyz)": "8c7cf764dc"}, selected="Account (shervinazadi93@gmail.com | https://speckle.xyz)",
    selectedId="8c7cf764dc",
    selectedServer="https://speckle.xyz")
sget = StreamGet(StreamIDURL="5be382cdb7", Account=list)
mesh = Mesh(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)
to_speckle = ToSpeckle(Data=mesh, selectedKitName="Objects")
panel = Panel("Send")
panel_2 = Panel("Receive")
send = Send(
    Data=to_speckle,
    Stream=sget,
    AutoSend=False,
    BaseId="f6d4386455e602653ff345582b1dc6a2",
    CurrentComponentState="up_to_date",
    KitName="Objects",
    OutputWrappers="https://speckle.xyz\t5be382cdb7\t383650beef",
    UseDefaultCache=True)
receive = Receive(
    Stream=sget,
    AutoReceive=False,
    CurrentComponentState="up_to_date",
    KitName="Objects",
    LastInfoMessage="Shervin Azadi @ 2021-08-18T09:52:10.443Z: Pushed 2 elements from Grasshopper. (id:383650beef)",
    ReceivedCommitId="383650beef",
    StreamWrapper="https://speckle.xyz/streams/5be382cdb7?u=8c7cf764dc")  # -> Data, Info
to_native = ToNative(Base=receive.Data, selectedKitName="Objects")
